# Grasshopper definition adapterReplaceExample.gh (Grasshopper 0.9.76)
# plug-ins: BH.UI.Grasshopper

number_slider = Slider(150, range=0..1000)
steel = Steel(
    {"S235": 0, "S275": 1, "S355": 2, "S450": 3}, selected="S275",
    Component="{ \"_t\": \"System.String\", \"_v\": \"Materials\\\\MaterialsEurope\\\\Steel\"}",
    Selection=1)
steelrectanglesection = SteelRectangleSection(Height=number_slider, Width=number_slider, CornerRadius=0, Material=steel, Component="{ .SteelRectangleSection")

toggle = BooleanToggle(False)
etabsadapter = ETABSAdapter(Active=toggle, Component="{ ..ctor")  # disabled
# CASE 1
# ReplaceThroughAPI
robotadapter = RobotAdapter(Active=toggle, Component="{ ..ctor")

# ----
# CASE 2
# ReplaceThroughAPI
# CASE 3
panel = Panel("Beams")

# ---- group: Beams - STATUS 1
line = Line([Line((0, -9.22142825, 11.88422398), (17.99876497, -9.22142825, 11.88422398)), Line((0, 0, 11.88422398), (17.99876497, 0, 11.88422398))])

# ---- group: Columns - STATUS 1
line_2 = Line([Line((0, -9.22142825, 0), (0, -9.22142825, 11.88422398)), Line((0, 0, 0), (0, 0, 11.88422398))])

# ----
# STATUS 1
# STATUS 1
bar = Bar(
    Line=line,
    Property=steelrectanglesection,
    OrientationAngle=0,
    FeaType="{ \"_t\" : \"System.Enum\", \"TypeName\" : { \"_t\" : \"System.Type\", \"Name\" : \"BH.oM.Structure.Elements.BarFEAType\" }, \"Value\" : \"Flexural\" }",
    Component="{ .Bar")
# STATUS 1
# STATUS 2
bar_2 = Bar(
    Line=line_2,
    Property=steelrectanglesection,
    OrientationAngle=0,
    FeaType="{ \"_t\" : \"System.Enum\", \"TypeName\" : { \"_t\" : \"System.Type\", \"Name\" : \"BH.oM.Structure.Elements.BarFEAType\" }, \"Value\" : \"Flexural\" }",
    Component="{ .Bar")
toggle_2 = BooleanToggle(True)
push = Push(Adapter=robotadapter, Objects=flatten(bar_2), Tag="Columns", Active=toggle_2, Component="{ .Push")  # -> Objects, Success
# STATUS 3
push_2 = Push(Adapter=robotadapter, Objects=flatten(bar), Tag=panel, Active=toggle_2, Component="{ .Push")  # -> Objects, Success

# ---- group: Columns - STATUS 2
line_3 = Line([Line((17.99876497, 0, 0), (17.99876497, 0, 11.88422398)), Line((0, 0, 0), (0, 0, 11.88422398))])

# ---- group: Beams - STATUS 2 (they don't change)
line_4 = Line(line)

# ---- group: Columns - STATUS 3
# STATUS 1
# Refer to "STATUS 1" block above
line_5 = Line([Line((17.99876497, 0, 0), (17.99876497, 0, 11.88422398)), Line((0, 0, 0), (0, 0, 11.88422398))])

# ---- group: Beams - STATUS 3
# UpdateOnly
# --> Make sure that it works even if tags are input in the second push.
line_6 = Line([Line((-17.99876497, 0, 11.88422398), (0, 0, 11.88422398)), Line((0, 0, 11.88422398), (17.99876497, 0, 11.88422398))])

# ----
# UpdateOnly - incorrect -> should fail
# --> Objects must be the same between Status 1 and Status 3U
# STATUS 1
# Refer to "STATUS 1" block above
createtype = CreateType(Component="{ \"_t\" : \"System.Type\", \"Name\" : \"System.Object, mscorlib, Version=4.0.0.0, Culture=neutral, PublicKeyToken=b77a5c561934e089\" }")
# CASE 4
createtype_2 = CreateType(Component="{ \"_t\" : \"System.Type\", \"Name\" : \"System.String, mscorlib, Version=4.0.0.0, Culture=neutral, PublicKeyToken=b77a5c561934e089\" }")
# STATUS 3U
# (UpdateOnly)
# STATUS 1
panel_2 = Panel("PushType")
createdictionary = CreateDictionary(Keys=panel_2, Values="UpdateOnly", KeyType=createtype_2, ValueType=createtype, Component="{ .CreateDictionary")

# ----
# STATUS 1
# Refer to "STATUS 1" block above
createtype_3 = CreateType(Component="{ \"_t\" : \"System.Type\", \"Name\" : \"System.Object, mscorlib, Version=4.0.0.0, Culture=neutral, PublicKeyToken=b77a5c561934e089\" }")
createtype_4 = CreateType(Component="{ \"_t\" : \"System.Type\", \"Name\" : \"System.String, mscorlib, Version=4.0.0.0, Culture=neutral, PublicKeyToken=b77a5c561934e089\" }")
# STATUS 1
# STATUS 1U
# (UpdateOnly)
panel_3 = Panel("PushType")
createdictionary_2 = CreateDictionary(Keys=panel_3, Values="UpdateOnly", KeyType=createtype_4, ValueType=createtype_3, Component="{ .CreateDictionary")

# ----
# STATUS 2
bar_3 = Bar(
    Line=line_3,
    Property=steelrectanglesection,
    OrientationAngle=0,
    FeaType="{ \"_t\" : \"System.Enum\", \"TypeName\" : { \"_t\" : \"System.Type\", \"Name\" : \"BH.oM.Structure.Elements.BarFEAType\" }, \"Value\" : \"Flexural\" }",
    Component="{ .Bar")
not = GateNot(A=toggle_2)
and = GateAnd(A=not, B=Toggle(False))
push_3 = Push(Adapter=robotadapter, Objects=flatten(bar_3), Tag="Columns", Active=and, Component="{ .Push")  # -> Objects, Success

# ----
# STATUS 3
bar_4 = Bar(
    Line=line_6,
    Property=steelrectanglesection,
    OrientationAngle=0,
    FeaType="{ \"_t\" : \"System.Enum\", \"TypeName\" : { \"_t\" : \"System.Type\", \"Name\" : \"BH.oM.Structure.Elements.BarFEAType\" }, \"Value\" : \"Flexural\" }",
    Component="{ .Bar")
bar_5 = Bar(
    Line=line_5,
    Property=steelrectanglesection,
    OrientationAngle=0,
    FeaType="{ \"_t\" : \"System.Enum\", \"TypeName\" : { \"_t\" : \"System.Type\", \"Name\" : \"BH.oM.Structure.Elements.BarFEAType\" }, \"Value\" : \"Flexural\" }",
    Component="{ .Bar")
not_2 = GateNot(A=toggle_2)
and_2 = GateAnd(A=not_2, B=Toggle(False))
push_4 = Push(Adapter=robotadapter, Objects=flatten(bar_5), Tag="Columns", Active=and_2, Component="{ .Push")  # -> Objects, Success
push_5 = Push(Adapter=robotadapter, Objects=flatten(bar_4), Tag=panel, Active=and_2, Component="{ .Push")  # -> Objects, Success

# ---- group: Columns - STATUS 3
line_7 = Line([Line((17.99876497, 0, 0), (17.99876497, 0, 11.88422398)), Line((0, 0, 0), (0, 0, 11.88422398))])

# ---- group: Beams - STATUS 3
line_8 = Line([Line((-17.99876497, 0, 11.88422398), (0, 0, 11.88422398)), Line((0, 0, 11.88422398), (17.99876497, 0, 11.88422398))])

# ----
c_script = CSharpScript(go=Button())  # inputs go: Boolean
# ---------- c_script: C# ----------
    //Component copies all inputs and outputs from one component to another
    //Useful when replacing an old component with a new with the same number of inputs in the same order
    //To use: Create a c# component with one input called "go" and type set to bool
    //Connect a button to the component
    //Select the two components you want to copy inputs between. The script will assume that the one with the most inputs will be the one to copy from
    //Hit the button. Will trigger a warning pop up that can be ignored.
    //Save your work before use!!
    try {
      GH_Component source;

      GH_Component target;

      Grasshopper.Kernel.GH_Document doc = this.GrasshopperDocument;

      List<GH_Component> selected = doc.SelectedObjects().Where(x => x is GH_Component).Cast<GH_Component>().ToList();

      if(selected.Count != 2)
        return;

      //selected = selected.OrderBy(x => x.Params.Input.Sum(y => y.SourceCount)).ToList();

      target = selected[1];

      source = selected[0];

      if(go)
      {
        for (int i = 0; i < source.Params.Input.Count; i++)
        {
          foreach (var s in source.Params.Input[i].Sources)
          {
            target.Params.Input[i].RemoveAllSources();
            target.Params.Input[i].AddSource(s);
          }
        }

        for (int i = 0; i < source.Params.Output.Count; i++)
        {
          foreach (var recep in source.Params.Output[i].Recipients)
          {
            target.Params.Output[i].RemoveAllSources();

            var output = target.Params.Output.Where(x => x.NickName == source.Params.Output[i].NickName).First();

            if(output != null)
              recep.AddSource(output);
            else
              Print(source.Params.Output[i].NickName);
          }
        }
      }
    } catch (Exception e) {}
# ---------- end c_script ----------

# ----
# STATUS 3U
bar_6 = Bar(
    Line=line_8,
    Property=steelrectanglesection,
    OrientationAngle=0,
    FeaType="{ \"_t\" : \"System.Enum\", \"TypeName\" : { \"_t\" : \"System.Type\", \"Name\" : \"BH.oM.Structure.Elements.BarFEAType\" }, \"Value\" : \"Flexural\" }",
    Component="{ .Bar")
bar_7 = Bar(
    Line=line_7,
    Property=steelrectanglesection,
    OrientationAngle=0,
    FeaType="{ \"_t\" : \"System.Enum\", \"TypeName\" : { \"_t\" : \"System.Type\", \"Name\" : \"BH.oM.Structure.Elements.BarFEAType\" }, \"Value\" : \"Flexural\" }",
    Component="{ .Bar")
not_3 = GateNot(A=toggle_2)
and_3 = GateAnd(A=not_3, B=Toggle(False))
# NOTES
# --> Should fail 'more visibly'
# --> Should state why it fails
push_6 = Push(Adapter=robotadapter, Objects=flatten(bar_7), Tag="Columns", Config=createdictionary, Active=and_3, Component="{ .Push")  # -> Objects, Success
push_7 = Push(Adapter=robotadapter, Objects=flatten(bar_6), Tag=panel, Config=createdictionary, Active=and_3, Component="{ .Push")  # -> Objects, Success

# ---- group: PROPERTY - STATUS 1U (Changed)
rhs = RHS(
    {"RHS 50x30x2.9": 0, "RHS 50x30x3.0": 1, "RHS 50x30x3.2": 2, "RHS 50x30x3.6": 3, "RHS 50x30x4.0": 4, "RHS 50x30x5.0": 5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}, selected="RHS 90x50x4.0": 31,
    Component="{ \"_t\": \"System.String\", \"_v\": \"SectionProperties\\\\UK_SteelSections\\\\RHS\"}",
    Selection=31)

# ----
# STATUS 1U
toggle_3 = BooleanToggle(True)
createtype_5 = CreateType(Component="{ \"_t\" : \"System.Type\", \"Name\" : \"BH.oM.Structure.Elements.Bar\" }")
createtype_6 = CreateType(Component="{ \"_t\" : \"System.Type\", \"Name\" : \"BH.oM.Structure.Elements.Bar\" }")
filterquery = FilterQuery(Type=createtype_5, Tag="Columns", Component="{ .FilterQuery")
and_4 = GateAnd(A=push.Success, B=push_2.Success, C=toggle_3)
filterquery_2 = FilterQuery(Type=createtype_6, Tag=panel, Component="{ .FilterQuery")
and_5 = GateAnd(A=push.Success, B=push_2.Success, C=toggle_3)
pull = Pull(Adapter=robotadapter, Query=filterquery, Active=and_4, Component="{ .Pull")
pull_2 = Pull(Adapter=robotadapter, Query=filterquery_2, Active=and_5, Component="{ .Pull")
setproperty = SetProperty(Obj=pull, PropName="SectionProperty", Value=rhs, Component="{ .SetProperty")
setproperty_2 = SetProperty(Obj=pull_2, PropName="SectionProperty", Value=rhs, Component="{ .SetProperty")
toggle_4 = BooleanToggle(True)
# NOTES
# --> Issue https://github.com/BHoM/BHoM_Adapter/issues/83
# 
# If tags are input in the Push, when UpdateOnly is config,
# UpdateOnly should not send the tags
# when calling ReplaceDependencies
push_8 = Push(Adapter=robotadapter, Objects=flatten(setproperty), Config=createdictionary_2, Active=toggle_4, Component="{ .Push")  # -> Objects, Success
push_9 = Push(Adapter=robotadapter, Objects=flatten(setproperty_2), Config=createdictionary_2, Active=toggle_4, Component="{ .Push")  # -> Objects, Success; disabled
