# Grasshopper definition distinctPropertiesExample.gh (Grasshopper 1.0.7)
# plug-ins: BH.UI.Grasshopper

number_slider = Slider(150, range=0..1000)
steel = Steel(Component="{ \"_t\": \"System.String\", \"_v\": \"Materials\\\\MaterialsEurope\\\\Steel\"}")
steelrectanglesection = SteelRectangleSection(Height=number_slider, Width=number_slider, CornerRadius=0, Material=steel, Component="{ .SteelRectangleSection")

toggle = BooleanToggle(True)
etabsadapter = ETABSAdapter(Active=toggle, Component="{ ..ctor")  # disabled
# CASE 1
robotadapter = RobotAdapter(Active=toggle, Component="{ ..ctor")

c_script = CSharpScript()  # inputs go: Boolean
# ---------- c_script: C# ----------
    //Component copies all inputs and outputs from one component to another
    //Useful when replacing an old component with a new with the same number of inputs in the same order
    //To use: Create a c# component with one input called "go" and type set to bool
    //Connect a button to the component
    //Select the two components you want to copy inputs between. The script will assume that the one with the most inputs will be the one to copy from
    //Hit the button. Will trigger a warning pop up that can be ignored.
    //Save your work before use!!
    try {
      GH_Component source;

      GH_Component target;

      Grasshopper.Kernel.GH_Document doc = this.GrasshopperDocument;

      List<GH_Component> selected = doc.SelectedObjects().Where(x => x is GH_Component).Cast<GH_Component>().ToList();

      if(selected.Count != 2)
        return;

      //selected = selected.OrderBy(x => x.Params.Input.Sum(y => y.SourceCount)).ToList();

      target = selected[1];

      source = selected[0];

      if(go)
      {
        for (int i = 0; i < source.Params.Input.Count; i++)
        {
          foreach (var s in source.Params.Input[i].Sources)
          {
            target.Params.Input[i].RemoveAllSources();
            target.Params.Input[i].AddSource(s);
          }
        }

        for (int i = 0; i < source.Params.Output.Count; i++)
        {
          foreach (var recep in source.Params.Output[i].Recipients)
          {
            target.Params.Output[i].RemoveAllSources();

            var output = target.Params.Output.Where(x => x.NickName == source.Params.Output[i].NickName).First();

            if(output != null)
              recep.AddSource(output);
            else
              Print(source.Params.Output[i].NickName);
          }
        }
      }
    } catch (Exception e) {}
# ---------- end c_script ----------
# Node 4
# Node 2 & 3
# Node 1
# These 2 lines will have a total
# of 4 distinct corresponding nodes.
line = Line([Line((0, 0, 0), (0, 0, 11.88422398)), Line((0, 0, 11.88422398), (17.99876497, 0, 11.88422398))])
# CASE 2
# Out of 3 nodes we build 2 lines.
# Node 3
# Node 2
# Node 1
pt = Point([Point(32.18820436, -15.06376934, 0), Point(32.18820436, 16.01025836, 0), Point(3.244254247, 16.01025836, 0)])
node = Node(Coordinates=pt, Component="{ .Node")
item = ListItem(List=node, Index=0, Wrap=True)  # -> Item, Item1, Item2

bar = Bar(
    Line=line,
    Property=steelrectanglesection,
    OrientationAngle=0,
    FeaType="{ \"_t\" : \"System.Enum\", \"TypeName\" : { \"_t\" : \"System.Type\", \"Name\" : \"BH.oM.Structure.Elements.BarFEAType\" }, \"Value\" : \"Flexural\" }",
    Component="{ .Bar")
push = Push(Adapter=robotadapter, Objects=flatten(bar), Active=Toggle(False), Component="{ .Push")  # -> Objects, Success

bar_2 = Bar(
    StartNode=item.Item,
    EndNode=item.Item2,
    OrientationAngle=0,
    FeaType="{ \"_t\" : \"System.Enum\", \"TypeName\" : { \"_t\" : \"System.Type\", \"Name\" : \"BH.oM.Structure.Elements.BarFEAType\" }, \"Value\" : \"Flexural\" }",
    Component="{ .Bar")
bar_3 = Bar(
    StartNode=item.Item,
    EndNode=item.Item1,
    OrientationAngle=0,
    FeaType="{ \"_t\" : \"System.Enum\", \"TypeName\" : { \"_t\" : \"System.Type\", \"Name\" : \"BH.oM.Structure.Elements.BarFEAType\" }, \"Value\" : \"Flexural\" }",
    Component="{ .Bar")
item_2 = ListItem(List=push.Objects, Index=0, Wrap=True)  # -> Item, Item1
push_2 = Push(Adapter=robotadapter, Objects=flatten([bar_3, bar_2]), Active=Toggle(False), Component="{ .Push")  # -> Objects, Success
explode = Explode(Object=item_2.Item, Component="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")  # -> StartNode, EndNode, SectionProperty, OrientationAngle, Release, FEAType, Support, Offset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
explode_2 = Explode(Object=item_2.Item1, Component="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")  # -> StartNode, EndNode, SectionProperty, OrientationAngle, Release, FEAType, Support, Offset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
item_3 = ListItem(List=push_2.Objects, Index=0, Wrap=True)
explode_3 = Explode(Object=bar_2, Component="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")  # -> StartNode, EndNode, SectionProperty, OrientationAngle, Release, FEAType, Support, Offset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
explode_4 = Explode(Object=item_3, Component="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")  # -> StartNode, EndNode, SectionProperty, OrientationAngle, Release, FEAType, Support, Offset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
explode_5 = Explode(Object=explode_2.EndNode, Component="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")  # -> Position, Orientation, Support, BHoM_Guid, Name, Tags, CustomData
explode_6 = Explode(Object=explode.EndNode, Component="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")  # -> Position, Orientation, Support, BHoM_Guid, Name, Tags, CustomData
explode_7 = Explode(Object=explode_2.StartNode, Component="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")  # -> Position, Orientation, Support, BHoM_Guid, Name, Tags, CustomData
explode_8 = Explode(Object=explode.StartNode, Component="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")  # -> Position, Orientation, Support, BHoM_Guid, Name, Tags, CustomData
panel = Panel(explode_7.BHoM_Guid)
panel_2 = Panel(explode_8.BHoM_Guid)
panel_3 = Panel(explode_5.BHoM_Guid)
panel_4 = Panel(explode_6.BHoM_Guid)
item_4 = ListItem(List=push_2.Objects, Index=0, Wrap=True)  # -> Item, Item1
explode_9 = Explode(Object=item_4.Item, Component="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")  # -> StartNode, EndNode, SectionProperty, OrientationAngle, Release, FEAType, Support, Offset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
explode_10 = Explode(Object=item_4.Item1, Component="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")  # -> StartNode, EndNode, SectionProperty, OrientationAngle, Release, FEAType, Support, Offset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
merge = Merge(Data1=panel_2, Data2=panel_4, Data3=panel, Data4=panel_3)
distinct = CSharpScript(x=merge)  # -> A; inputs x: list of String
# ---------- distinct: C# ----------
    A = x.Distinct();
# ---------- end distinct ----------
explode_11 = Explode(Object=explode_10.EndNode, Component="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")  # -> Position, Orientation, Support, BHoM_Guid, Name, Tags, CustomData
explode_12 = Explode(Object=explode_9.EndNode, Component="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")  # -> Position, Orientation, Support, BHoM_Guid, Name, Tags, CustomData
explode_13 = Explode(Object=explode_10.StartNode, Component="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")  # -> Position, Orientation, Support, BHoM_Guid, Name, Tags, CustomData
# These 2 lines will have a total
# of 4 distinct corresponding nodes.
panel_5 = Panel(distinct)
explode_14 = Explode(Object=explode_9.StartNode, Component="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")  # -> Position, Orientation, Support, BHoM_Guid, Name, Tags, CustomData
panel_6 = Panel(explode_13.BHoM_Guid)
panel_7 = Panel(explode_14.BHoM_Guid)
panel_8 = Panel(explode_11.BHoM_Guid)
panel_9 = Panel(explode_12.BHoM_Guid)
merge_2 = Merge(Data1=panel_7, Data2=panel_9, Data3=panel_6, Data4=panel_8)
distinct_2 = CSharpScript(x=merge_2)  # -> A; inputs x: list of String; same code as distinct
# These 2 lines will have a total
# of 3 distinct corresponding nodes.
panel_10 = Panel(distinct_2)
