# Grasshopper definition equalityComparersExample.gh (Grasshopper 1.0.7)
# plug-ins: BH.UI.Grasshopper

number_slider = Slider(150, range=0..1000)
# CASE 5
# Push the same bar twice
steel = Steel(Component="{ \"_t\": \"System.String\", \"_v\": \"Materials\\\\MaterialsEurope\\\\Steel\"}")
steelrectanglesection = SteelRectangleSection(Height=number_slider, Width=number_slider, CornerRadius=0, Material=steel, Component="{ .SteelRectangleSection")

toggle = BooleanToggle(True)
etabsadapter = ETABSAdapter(Active=toggle, Component="{ ..ctor")  # disabled
robotadapter = RobotAdapter(Active=toggle, Component="{ ..ctor")

# ----
# CASE 4
# Push two identical bars
pt = Point([Point(32.18820436, -15.06376934, 0), Point(32.18820436, 16.01025836, 0), Point(3.244254247, 16.01025836, 0)])
node = Node(Coordinates=pt, Component="{ .Node")
# CASE 3
# Push two identical nodes
pt_2 = Point([Point(32.18820436, -15.06376934, 0), Point(32.18820436, 16.01025836, 0), Point(3.244254247, 16.01025836, 0)])
item = ListItem(List=pt_2, Index=0, Wrap=True)
item_2 = ListItem(List=node, Index=0, Wrap=True)  # -> Item, Item1, Item2
node_2 = Node(Coordinates=item, Component="{ .Node")
node_3 = Node(Coordinates=item, Component="{ .Node")
# CASE 1
# Push the same bar twice
# CASE 6
# Push the same node twice
pt_3 = Point([Point(32.18820436, -15.06376934, 0), Point(32.18820436, 16.01025836, 0), Point(3.244254247, 16.01025836, 0)])
node_4 = Node(Coordinates=pt_3, Component="{ .Node")
bar = Bar(
    StartNode=item_2.Item,
    EndNode=item_2.Item1,
    OrientationAngle=0,
    FeaType="{ \"_t\" : \"System.Enum\", \"TypeName\" : { \"_t\" : \"System.Type\", \"Name\" : \"BH.oM.Structure.Elements.BarFEAType\" }, \"Value\" : \"Flexural\" }",
    Component="{ .Bar")
bar_2 = Bar(
    StartNode=item_2.Item,
    EndNode=item_2.Item1,
    OrientationAngle=0,
    FeaType="{ \"_t\" : \"System.Enum\", \"TypeName\" : { \"_t\" : \"System.Type\", \"Name\" : \"BH.oM.Structure.Elements.BarFEAType\" }, \"Value\" : \"Flexural\" }",
    Component="{ .Bar")
item_3 = ListItem(List=node_4, Index=0, Wrap=True)  # -> Item, Item1, Item2
# CASE 2
# Push the same node twice
pt_4 = Point([Point(32.18820436, -15.06376934, 0), Point(32.18820436, 16.01025836, 0), Point(3.244254247, 16.01025836, 0)])
bar_3 = Bar(
    StartNode=item_3.Item,
    EndNode=item_3.Item1,
    OrientationAngle=0,
    FeaType="{ \"_t\" : \"System.Enum\", \"TypeName\" : { \"_t\" : \"System.Type\", \"Name\" : \"BH.oM.Structure.Elements.BarFEAType\" }, \"Value\" : \"Flexural\" }",
    Component="{ .Bar")
node_5 = Node(Coordinates=pt_4, Component="{ .Node")
item_4 = ListItem(List=node_5, Index=0, Wrap=True)  # -> Item, Item1, Item2
data = Data(bar_3)
data_2 = Data(item_4.Item)
push = Push(Adapter=robotadapter, Objects=flatten([bar_3, data]), Active=Toggle(True), Component="{ .Push")  # -> Objects, Success
push_2 = Push(Adapter=robotadapter, Objects=flatten([node_3, node_2]), Active=Toggle(False), Component="{ .Push")  # -> Objects, Success
push_3 = Push(Adapter=robotadapter, Objects=flatten([bar_2, bar]), Active=Toggle(False), Component="{ .Push")  # -> Objects, Success
push_4 = Push(Adapter=robotadapter, Objects=flatten([item_4.Item, data_2]), Active=Toggle(True), Component="{ .Push")  # -> Objects, Success
panel = Panel(push.Objects)
item_5 = ListItem(List=push.Objects, Index=0, Wrap=True)  # -> Item, Item1
item_6 = ListItem(List=push_2.Objects, Index=0, Wrap=True)
item_7 = ListItem(List=push_3.Objects, Index=0, Wrap=True)
item_8 = ListItem(List=push_4.Objects, Index=0, Wrap=True)  # -> Item, Item1
panel_2 = Panel(push_4.Objects)
explode = Explode(Object=item_5.Item, Component="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")  # -> StartNode, EndNode, SectionProperty, OrientationAngle, Release, FEAType, Support, Offset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
explode_2 = Explode(Object=item_5.Item1, Component="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")  # -> StartNode, EndNode, SectionProperty, OrientationAngle, Release, FEAType, Support, Offset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
explode_3 = Explode(Object=item_6, Component="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")  # -> StartNode, EndNode, SectionProperty, OrientationAngle, Release, FEAType, Support, Offset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
explode_4 = Explode(Object=item_7, Component="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")  # -> StartNode, EndNode, SectionProperty, OrientationAngle, Release, FEAType, Support, Offset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
explode_5 = Explode(Object=item_8.Item1, Component="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")  # -> Position, Orientation, Support, BHoM_Guid, Name, Tags, CustomData
explode_6 = Explode(Object=item_8.Item, Component="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")  # -> Position, Orientation, Support, BHoM_Guid, Name, Tags, CustomData
panel_3 = Panel(explode_2.BHoM_Guid)
panel_4 = Panel(explode.BHoM_Guid)
createtype = CreateType(Component="{ \"_t\" : \"System.Type\", \"Name\" : \"BH.oM.Structure.Elements.Bar\" }")
panel_5 = Panel(explode_5.BHoM_Guid)
panel_6 = Panel(explode_6.BHoM_Guid)
createtype_2 = CreateType(Component="{ \"_t\" : \"System.Type\", \"Name\" : \"BH.oM.Structure.Elements.Node\" }")
filterquery = FilterQuery(Type=createtype, Component="{ .FilterQuery")
filterquery_2 = FilterQuery(Type=createtype_2, Component="{ .FilterQuery")
pull = Pull(Adapter=robotadapter, Query=filterquery, Active=push.Success, Component="{ .Pull")
pull_2 = Pull(Adapter=robotadapter, Query=filterquery_2, Active=push_4.Success, Component="{ .Pull")
# - All BHoM object should have a default Comparer that looks for GUID
panel_7 = Panel(pull)
# - Probably the objects in the Push output should be the same as the one in the Pull output
panel_8 = Panel(pull_2)
