# Grasshopper definition diffingTest.gh (Grasshopper 0.9.76)
# plug-ins: BH.UI.Grasshopper

# ----
# Create Objects
panel = Panel("1,1,1")
pt = Point("1,1,0")
pt_2 = Point(panel)
pt_3 = Point("0,0,0")
# CREATE AND PUSH STREAM
bar = Bar(
    StartNode=pt_3,
    EndNode=pt_2,
    OrientationAngle=0,
    FeaType="{ \"_t\" : \"System.Enum\", \"TypeName\" : { \"_t\" : \"System.Type\", \"Name\" : \"BH.oM.Structure.Elements.BarFEAType\" }, \"Value\" : \"Flexural\" }",
    Component="{ .Bar")
bar_2 = Bar(
    StartNode=pt_3,
    EndNode=pt,
    OrientationAngle=0,
    FeaType="{ \"_t\" : \"System.Enum\", \"TypeName\" : { \"_t\" : \"System.Type\", \"Name\" : \"BH.oM.Structure.Elements.BarFEAType\" }, \"Value\" : \"Flexural\" }",
    Component="{ .Bar")
bar_3 = Bar(
    StartNode=pt_3,
    EndNode=pt_2,
    OrientationAngle=0,
    FeaType="{ \"_t\" : \"System.Enum\", \"TypeName\" : { \"_t\" : \"System.Type\", \"Name\" : \"BH.oM.Structure.Elements.BarFEAType\" }, \"Value\" : \"Flexural\" }",
    Component="{ .Bar")

# ----
# Create Stream
create_stream = CSharpScript(
    streamName="testStream",
    streamId="randomString123124",
    Reference=["C:\Users\alombardi\GitHub\BHoM\Build\BHoM.dll", "C:\Users\alombardi\GitHub\BHoM\Build\Diffing_oM.dll"])  # -> Stream; inputs streamName: String, streamId: String, revision: Int32
# ---------- create_stream: C# ----------
    BH.oM.Diffing.Stream str = new BH.oM.Diffing.Stream(streamName, streamId, revision);
    Stream = str;
# ---------- end create_stream ----------
diffing = Diffing(
    CurrentObjs=[bar_2, bar, bar_3],
    PropertyLevelDiffing=True,
    UseDefaultExceptions=True,
    DiffStream=create_stream,
    Component="{ .Diffing")

explode = Explode(Object=diffing, Component="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")  # -> OnlySetA, OnlySetB, Modified, ModifiedPropsPerObject, DiffingStream, Timestamp, Author
objectstopush = Data(explode.OnlySetA)
explode_2 = Explode(Object=objectstopush, Component="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")  # -> StartNode, EndNode, SectionProperty, OrientationAngle, Release, FEAType, Support, Offset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
panel_2 = Panel(explode_2.Fragments)
explode_3 = Explode(Object=explode_2.Fragments, Component="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")  # -> Hash, PreviousHash, DiffingStream, BHoM_Guid, Name, Fragments, Tags, CustomData
panel_3 = Panel(explode_3.DiffingStream)
panel_4 = Panel(explode_3.Hash)

# ----
# PUSH
panel_5 = Panel("testDiffing.json")
fileadapter = FileAdapter(Folder="C:/temp", FileName=panel_5, Component="{ ..ctor")
push = Push(Adapter=fileadapter, Objects=flatten(objectstopush), Active=Toggle(True), Component="{ .Push")  # -> Objects, Success

# ----
# PULL
panel_6 = Panel("testDiffing.json")
# PULL STREAM, MODIFY OBJECTS AND DIFF
panel_7 = Panel("C:/temp")
fileadapter_2 = FileAdapter(Folder=panel_7, FileName=panel_6, Component="{ ..ctor")
createtype = CreateType(Component="BH.oM.Base.IBHoMObject")
filterrequest = FilterRequest(Type=createtype, Component="{ .FilterRequest")
pull = Pull(Adapter=fileadapter_2, Request=filterrequest, Active=Toggle(True), Component="{ .Pull")
panel_8 = Panel(pull)

pulledobjs = Data(pull)
explode_4 = Explode(Object=pulledobjs, Component="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")  # -> StartNode, EndNode, SectionProperty, OrientationAngle, Release, FEAType, Support, Offset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

# ----
# MODIFY PULLED OBJECTS
pulledobjs_2 = Data(pulledobjs)
# One bar is discarded (will get deleted)
bang = ExplodeTree(Data=simplify(graft(pulledobjs_2)))  # -> Branch0, Branch1, Branch2
pt_4 = Point("7,7,7")
pt_5 = Point("9,9,9")
setproperty = SetProperty(Obj=bang.Branch1, PropName="StartNode", Value=pt_5, Component="{ .PropertyValue")
setproperty_2 = SetProperty(Obj=bang.Branch2, PropName="EndNode", Value=pt_4, Component="{ .PropertyValue")

# ----
# CREATE NEW OBJECTS
# to be added to the stream
panel_9 = Panel("5,5,5")
pt_6 = Point("0,0,0")
pt_7 = Point(panel_9)
bar_4 = Bar(
    StartNode=pt_6,
    EndNode=pt_7,
    OrientationAngle=0,
    FeaType="{ \"_t\" : \"System.Enum\", \"TypeName\" : { \"_t\" : \"System.Type\", \"Name\" : \"BH.oM.Structure.Elements.BarFEAType\" }, \"Value\" : \"Flexural\" }",
    Name="newBar",
    Component="{ .Bar")

panel_10 = Panel(explode_4.Fragments)
explode_5 = Explode(Object=explode_4.Fragments, Component="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")  # -> Hash, PreviousHash, DiffingStream, BHoM_Guid, Name, Fragments, Tags, CustomData
panel_11 = Panel(explode_5.DiffingStream)
panel_12 = Panel(explode_5.Hash)

modifiedobjs = Data([setproperty, setproperty_2])
newobjects = Data(bar_4)
merge = Merge(Data1=modifiedobjs, Data2=newobjects)  # -> flatten(Result)
currentobjects = Data(merge)

# ----
# PERFORM DIFFING
panel_13 = Panel("randomString123124")
update_stream = CSharpScript(
    streamName="testStream",
    streamId=panel_13,
    Reference=["C:\Users\alombardi\GitHub\BHoM\Build\BHoM.dll", "C:\Users\alombardi\GitHub\BHoM\Build\Diffing_oM.dll"])  # -> Stream; inputs streamName: String, streamId: String
# ---------- update_stream: C# ----------
    BH.oM.Diffing.Stream str = new BH.oM.Diffing.Stream(streamName, streamId);
    Stream = str;
# ---------- end update_stream ----------
pulledobjs_3 = Data(pulledobjs)
currentobjects_2 = Data(currentobjects)
diffing_2 = Diffing(
    CurrentObjs=flatten(currentobjects_2),
    ReadObjs=flatten(pulledobjs_3),
    PropertyLevelDiffing=True,
    UseDefaultExceptions=True,
    DiffStream=update_stream,
    Component="{ .Diffing")

explode_6 = Explode(Object=diffing_2, Component="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")  # -> OnlySetA, OnlySetB, Modified, ModifiedPropsPerObject, DiffingStream, Timestamp, Author
explode_dictionary = CSharpScript(x=explode_6.ModifiedPropsPerObject)  # -> objsHash, propName, propValue_Current, propValue_Read
# ---------- explode_dictionary: C# ----------
    var objsHashTree = new Grasshopper.DataTree<string>();
    var propNameTree = new Grasshopper.DataTree<string>();
    var propValue_CurrentTree = new Grasshopper.DataTree<object>();
    var propValue_ReadTree = new Grasshopper.DataTree<object>();

    var dict = new Dictionary<string, Dictionary<string, Tuple<object, object>>>();
    dict = (Dictionary<string, Dictionary<string, Tuple<object, object>>>) x;

    int i = 0;
    foreach (var item in dict)
    {
      var path = new GH_Path(i);

      objsHashTree.Add(item.Key, path);

      foreach (var propItem in item.Value)
      {
        propNameTree.Add(propItem.Key, path);
        propValue_CurrentTree.Add(propItem.Value.Item1, path);
        propValue_ReadTree.Add(propItem.Value.Item2, path);
      }

      i += 1;
    }

    objsHash = objsHashTree;
    propName = propNameTree;
    propValue_Current = propValue_CurrentTree;
    propValue_Read = propValue_ReadTree;
# ---------- end explode_dictionary ----------
panel_14 = Panel(explode_6.OnlySetB)
panel_15 = Panel(explode_6.OnlySetA)
panel_16 = Panel(explode_dictionary.propValue_Current)
panel_17 = Panel(explode_dictionary.propName)
